# Grasshopper definition presskit.gh (Grasshopper 0.9.80)

number_slider = Slider(3.22, range=0..50)
number_slider_2 = Slider(7.13, range=0..50)
number_slider_3 = Slider(47, range=0..50)
number_slider_4 = Slider(47, range=0..50)
multiplication = Multiplication(A=Slider(3.22, range=0..50), B=-0.5)
multiplication_2 = Multiplication(A=number_slider, B=-0.5)
rectangle = Rectangle(Plane=PlaneXY(0, 0, 0), XSize=number_slider, YSize=Slider(7.13, range=0..50), Radius=0)  # -> Rectangle, Length
rectangle_2 = Rectangle(Plane=PlaneXY(0, 0, 0), XSize=Slider(7.13, range=0..50), YSize=Slider(3.22, range=0..50), Radius=0)  # -> Rectangle, Length
rectangle_3 = Rectangle(Plane=PlaneXY(0, 0, 0), XSize=Slider(3.22, range=0..50), YSize=Slider(7.13, range=0..50), Radius=0)  # -> Rectangle, Length
multiplication_3 = Multiplication(A=number_slider_4, B=-0.5)
multiplication_4 = Multiplication(A=number_slider_3, B=-0.5)
vector_xyz = VectorXYZ(XComponent=multiplication, YComponent=Slider(16.5, range=0..50), ZComponent=0)  # -> Vector, Length
vector_xyz_2 = VectorXYZ(XComponent=multiplication_2, YComponent=Slider(16.5, range=0..50), ZComponent=0)  # -> Vector, Length
vector_xyz_3 = VectorXYZ(XComponent=Slider(14.5, range=0..50), YComponent=Slider(41, range=0..50), ZComponent=0)  # -> Vector, Length
vector_xyz_4 = VectorXYZ(XComponent=Slider(56, range=0..100), YComponent=Slider(0, range=0..50), ZComponent=0)  # -> Vector, Length
rectangle_4 = Rectangle(Plane=PlaneXY(0, 0, 0), XSize=number_slider_4, YSize=number_slider_3, Radius=0)  # -> Rectangle, Length
move = Move(Motion=vector_xyz.Vector)  # -> Geometry, Transform
move_2 = Move(Geometry=rectangle.Rectangle, Motion=vector_xyz_2.Vector)  # -> Geometry, Transform
move_3 = Move(Geometry=rectangle_2.Rectangle, Motion=vector_xyz_3.Vector)  # -> Geometry, Transform
move_4 = Move(Geometry=rectangle_3.Rectangle, Motion=vector_xyz_4.Vector)  # -> Geometry, Transform
vector_xyz_5 = VectorXYZ(XComponent=multiplication_3, YComponent=multiplication_4, ZComponent=0)  # -> Vector, Length
move_5 = Move(Geometry=rectangle_4.Rectangle, Motion=vector_xyz_5.Vector)  # -> Geometry, Transform
polar_array = PolarArray(Geometry=move.Geometry, Plane=PlaneXY(0, 0, 0), Count=Slider(4, range=0..8), Angle=6.283185307)  # -> Geometry, Transform
polar_array_2 = PolarArray(Geometry=move_2.Geometry, Plane=PlaneXY(0, 0, 0), Count=Slider(4, range=0..8), Angle=6.283185307)  # -> Geometry, Transform
