# Grasshopper definition 3D plus laser.gh (Grasshopper 0.9.80)

surface = Surface(<surface referenced from the Rhino model>)
box = Box({Plane=Plane(origin=(-74.38838573, -58.28311033, 0), x=(0, 1, 0), y=(1, 0, 0)), X=Domain(0, 52.84918322), Y=Domain(0, 27.54462924), Z=Domain(-3.698039305, 0)})
geometry = Geometry(<curve referenced from the Rhino model>)
divide_domain² = DivideDomain²(Domain=surface, UCount=Slider(10, range=0..110), VCount=Slider(10, range=0..110))
surface_box = SurfaceBox(Surface=surface, Domain=divide_domain², Height=1)
box_morph = BoxMorph(Geometry=geometry, Reference=box, Target=surface_box)
